vi "Main.gviweb"   [LabVIEW NXG 2.0.0]
panel controls:
  "Slider": f64
  "Numeric": f64 = 300000
  "Slider_3": f64
  "Slider_4": f64
panel indicators:
  "Tank": f64
  "Graph": f64[][]
  "Gauge": f64
  "Radial Progress Bar": f64
  "Data Grid": T1[]
  "URL Image_2": string
  "LED": bool
types:
  T1 = cluster{"Testers": string, "Test Progress": f64, "Test Status": bool}
diagram:
  disable {
    frame Enabled { }
    frame Disabled {
      while {
        Wait(time to wait=150)
        Add($Slider)
        stop if FALSE
      }
    }
  }
  while {
    Random Number() -> (number (0 to 1)=w1)
    Multiply(w1, 5000) -> w2
    Add($Slider_3, w2, $Numeric) -> w3
    $Gauge <- w3
    Is Greater(x=w3, y=500000) -> w4
    $LED <- w4
    Wait(time to wait=150)
    stop if FALSE
  }
  w5 = [{"Testers"="e-DUT-13A", "Test Progress"=96, "Test Status"=TRUE}, {"Testers"="f-DUT-46C", "Test Progress"=33, "Test Status"=FALSE}, {"Testers"="g-DUT-55k", "Test Progress"=75, "Test Status"=TRUE}, {"Testers"="g-DUT-87H", "Test Progress"=5, "Test Status"=TRUE}, {"Testers"="g-DUT-MAB", "Test Progress"=100, "Test Status"=FALSE}]
  $"Data Grid" <- w5
  $"Radial Progress Bar" <- $Slider_4
  while {
    for (N = 100) (iteration -> i1) {
      Divide(x=i1, y=10) -> w8
      Sine(x=w8) -> w9
      Random Number() -> (number (0 to 1)=w10)
      Add(w9, w10) -> w11
      Random Number() -> (number (0 to 1)=w12)
      Divide(x=w12, y=10) -> w13
      Add(w13, 1) -> w14
      append w11 to w6
      append w14 to w7
    }
    Build Array(w6, w7) -> w15
    $Graph <- w15
    Wait(time to wait=16)
    stop if FALSE
  }
